# Dynamo graph Rooms.Delete.dyn (Dynamo 2.16.1.2727)
# author: Julia Lubacheski
# Deleta rooms perdidas

rooms_by_status = RoomsByStatus()
delete = Element.Delete(element=rooms_by_status.NotEnclosedRooms)
rooms_by_status_2 = RoomsByStatus()
delete_2 = Element.Delete(element=rooms_by_status_2.UnplacedRooms)
