# Dynamo graph StreelStructure.Creator.dyn (Dynamo 2.16.1.2727)
# author: Julia Lubacheski
# Modelador de Estruturas Metálicas
# packages: MEPover 2022.10.30, Structural Design 2023.4.25

# group: Tamanho do Frame
n02_altura_do_galpão = DoubleSlider(5, range=1..30 step 1)  # "02. Altura do Galpão"; graph input
code_block = CodeBlock(a=n02_altura_do_galpão) { a*1000; }
n01_largura_do_galpão = DoubleSlider(20, range=1..30 step 1)  # "01. Largura do Galpão"; graph input
code_block_2 = CodeBlock(a=n01_largura_do_galpão) { a*1000; }
ângulo_do_frame = DoubleSlider(0, range=0..30 step 1)

# group: Offset do ponto de origen
x_in_m_number_slider = DoubleSlider(0, range=-30..30 step 1)
code_block_3 = CodeBlock(a=x_in_m_number_slider) { a*1000; }
y_in_m_number_slider = DoubleSlider(0, range=-30..30 step 1)
code_block_4 = CodeBlock(a=y_in_m_number_slider) { a*1000; }
z_in_m_number_slider = DoubleSlider(0, range=0..30 step 1)
code_block_5 = CodeBlock(a=z_in_m_number_slider) { a*1000; }
byCoordinates = Point.ByCoordinates(x=code_block_3, y=code_block_4, z=code_block_5)

# group: Criação do Vetor de Origen
rotação = DoubleSlider(1, range=-1..80 step 0.1)
rotação_2 = DoubleSlider(0, range=-1..854716917506036.0 step 0.1)
byCoordinates_2 = Vector.ByCoordinates(x=rotação, y=rotação_2)

# group: Profundidade do Frame
n03_profundidade_de_máxima_do = DoubleSlider(50, range=1..50 step 1)  # "03. Profundidade de Máxima do Galpão"; graph input
n04_distrancia_entre_eixos = DoubleSlider(5, range=1..30 step 1)  # "04. Distrancia entre Eixos"; graph input

# group: Criador das Curvas de Frame
byWidthHeightAngles = StructuralDesign.Model.Frame.ByWidthHeightAngles(insertionPoint=byCoordinates, vector=byCoordinates_2, width=code_block_2, height=code_block, angle=ângulo_do_frame)
boolean = BoolSelector(true)
code_block_6 = CodeBlock(profundidade=n03_profundidade_de_máxima_do, distanciamáxima=n04_distrancia_entre_eixos) { profundidade / distanciamáxima; }
code_block_7 = CodeBlock(a=n04_distrancia_entre_eixos) { a*1000; }
copy = StructuralDesign.Model.Frame.Copy(frame2DGeometry=byWidthHeightAngles.2DFrame, withEqualSpacing=boolean, numberOfTimes=code_block_6, spacing=code_block_7)

# group: Revisão de Criador de Purlins pelos Frames
code_block_8 = CodeBlock { 200; }
code_block_9 = CodeBlock { 50; }
numero_de_purlins = DoubleSlider(5, range=1..30 step 1)  # graph input
purlins = StructuralDesign.Model.Frame.Purlins(rafters=copy.Beams, number=numero_de_purlins)  # frozen

# group: Criador das curvas de vigas entre colunas
travamento_pelo_meio = CodeBlock(a=code_block) { a/2; }
travamento_de_topo = CodeBlock(a=code_block) { a/1.03; }
list_create = List.Create(item0=travamento_pelo_meio, item1=travamento_de_topo)
sideRailsEavesBeams = StructuralDesign.Model.Frame.SideRailsEavesBeams(columns=copy.Columns, heights=travamento_pelo_meio)

categories = Categories("OST_Levels")
all_elements_of_category = ElementsOfCategory(Category=categories)
elevation = Level.Elevation(level=all_elements_of_category)

# group: Filtra o Level correspondente ao Ponto Z da origen
Z = Point.Z(point=byCoordinates)
nearest_value_from_list_of = Custom[Nearest value from list of values](Value=Z, ListOfValues=elevation)  # package MEPover; Finds the nearest values from a given list of values
eq = elevation == nearest_value_from_list_of
filterByBoolMask = List.FilterByBoolMask(list=all_elements_of_category, mask=eq)

# group: Famílias Tipos
RAFTER = StructuralFramingTypes("UB305x165x40")
PURLIN = StructuralFramingTypes("150x90x24PFC")
v_bracing = StructuralFramingTypes("100x50x10PFC")
rail = StructuralFramingTypes("HSS152.4X152.4X9.5")
BRACING = StructuralFramingTypes("100x50x10PFC")
structural_column_types = StructuralColumnTypes("UC305x305x97")

# group: Revisão de Estrutura Intermediária
code_block_10 = CodeBlock { 6; }
code_block_11 = CodeBlock(a=n04_distrancia_entre_eixos) { a/2; }
round = Math.Round(number=code_block_11)
code_block_12 = CodeBlock(a=n04_distrancia_entre_eixos) { a - 1; }
code_block_13 = CodeBlock(b=round, a=code_block_12) { [1,b,a]; }
code_block_14 = CodeBlock(a=n04_distrancia_entre_eixos) { [1,(a -1)]; }
code_block_15 = CodeBlock(a=n04_distrancia_entre_eixos, b=code_block_10, c=code_block_13, g=code_block_14)  # frozen
# ---------- code_block_15.designscript (16 lines) ----------
a;
b;
c;
g;

d = [Imperative]
{
if(a>b)
{
return = c;
}
else
{
return = g;
}
};
# ----------------------------------------
VBracings = StructuralDesign.Model.Frame.VBracings(points=sideRailsEavesBeams.Points, zones=code_block_15.out4)
XBracings = StructuralDesign.Model.Frame.XBracings(points=purlins.Points, zones=code_block_15.out4)

# group: Revisão de Estruturas Intermediárias
structuralframing_beambycurve = StructuralFraming.BeamByCurve(curve=copy.Beams, level=filterByBoolMask.in, structuralFramingType=RAFTER, lacing=Longest)  # "StructuralFraming.BeamByCurve (vigas de lar. do telhado)"; frozen
structuralframing_bracebycurve = StructuralFraming.BraceByCurve(curve=purlins.Purlins, level=filterByBoolMask.in, structuralFramingType=PURLIN, lacing=Longest)  # "StructuralFraming.BraceByCurve (vigas de prof. do telhado)"
braceByCurve = StructuralFraming.BraceByCurve(curve=VBracings, level=filterByBoolMask.in, structuralFramingType=v_bracing, lacing=Longest)  # frozen
braceByCurve_2 = StructuralFraming.BraceByCurve(curve=XBracings, level=filterByBoolMask.in, structuralFramingType=BRACING, lacing=Longest)  # frozen

structuralframing_beambycurve_2 = StructuralFraming.BeamByCurve(curve=sideRailsEavesBeams.Beams, level=filterByBoolMask.in, structuralFramingType=rail, lacing=Longest)  # "StructuralFraming.BeamByCurve (intermediária)"
columnByCurve = StructuralFraming.ColumnByCurve(curve=copy.Columns, level=filterByBoolMask.in, structuralColumnType=structural_column_types, lacing=Longest)
code_block_16 = CodeBlock { "Cross-Section Rotation"; 90; }
setParameterByName = Element.SetParameterByName(element=columnByCurve, parameterName=code_block_16.out0, value=code_block_16.out1)

# group: Rangerizador do Y do Truss
code_block_17 = CodeBlock(a=n03_profundidade_de_máxima_do) { a*1000; }
code_block_18 = CodeBlock(a=n04_distrancia_entre_eixos) { a*1000; }
range = Range(start=code_block_4, end=code_block_17, step=code_block_18)
byCoordinates_3 = Point.ByCoordinates(x=code_block_3, y=range, z=code_block)

# group: Estrutura do Truss
n05_altura_da_estrutura_do_truss = DoubleSlider(1, range=0..3 step 0.1)  # "05. Altura da Estrutura do Truss"; graph input
n06_estrutura_sup_do_trus_com_2 = BoolSelector(true)  # "06. Estrutura Sup do Trus com 2 Águas"
n08_altura_da_cumeeira = DoubleSlider(1, range=0..100 step 0.1)  # "08. Altura da Cumeeira"
n07_estrutura_inf_do_truss_com_2 = BoolSelector(true)  # "07. Estrutura Inf do Truss com 2 Águas"

# group: Criador de Truss
code_block_19 = CodeBlock(a=n05_altura_da_estrutura_do_truss) { a*1000; }
code_block_20 = CodeBlock(a=n08_altura_da_cumeeira) { a*1000; }
code_block_21 = CodeBlock { 0; }
if_ = RefactoredIf(test=n06_estrutura_sup_do_trus_com_2, true=code_block_20, false=code_block_21)
if_2 = RefactoredIf(test=n07_estrutura_inf_do_truss_com_2, true=code_block_20, false=code_block_21)
warren = StructuralDesign.Model.WarrenTruss.Truss.Warren(insertionPoint=byCoordinates_3, length=code_block_2, startHeight=code_block_19, endHeight=code_block_19, d1=if_, d2=if_2)

# group: Criador de Purlins
transpose = List.Transpose(lists=warren.Posts)
numero_de_purlins_2 = DoubleSlider(2, range=1..30 step 1)  # graph input
purlins_2 = StructuralDesign.Model.Frame.Purlins(rafters=transpose, number=numero_de_purlins_2, lacing=Longest)

structuralframing_bracebycurve_2 = StructuralFraming.BraceByCurve(curve=purlins_2.Purlins, level=filterByBoolMask.in, structuralFramingType=PURLIN, lacing=Longest)  # "StructuralFraming.BraceByCurve (vigas de prof. do telhado)"
columnByCurve_2 = StructuralFraming.ColumnByCurve(curve=warren.Posts, level=filterByBoolMask.in, structuralColumnType=structural_column_types, lacing=Longest)
code_block_22 = CodeBlock { "Cross-Section Rotation"; 90; }
setParameterByName_2 = Element.SetParameterByName(element=columnByCurve_2, parameterName=code_block_22.out0, value=code_block_22.out1)
structuralframing_beambycurve_3 = StructuralFraming.BeamByCurve(curve=warren.Chords, level=filterByBoolMask.in, structuralFramingType=RAFTER, lacing=Longest)  # "StructuralFraming.BeamByCurve (vigas de lar. do telhado)"
structuralframing_bracebycurve_3 = StructuralFraming.BraceByCurve(curve=warren.Diagonals, level=filterByBoolMask.in, structuralFramingType=PURLIN, lacing=Longest)  # "StructuralFraming.BraceByCurve (vigas de prof. do telhado)"
