# Dynamo graph Views.CreatefromLevels.dyn (Dynamo 2.16.1.2727)
# author: Julia Lubacheski
# Cria Vistas de Planta Baixa a partir de Levels

categories = Categories("OST_Levels")
all_elements_of_category = ElementsOfCategory(Category=categories)
byLevel = FloorPlanView.ByLevel(level=all_elements_of_category)
code_block = CodeBlock { "Name"; "View Name"; }
getParameterValueByName = Element.GetParameterValueByName(element=all_elements_of_category, parameterName=code_block.out0)
code_block_2 = CodeBlock { 100; }
range = Range(end=code_block_2)
code_block_3 = CodeBlock(Nomedonível=getParameterValueByName, range=range) { Nomedonível + " - PAV " + range; }
setParameterByName = Element.SetParameterByName(element=byLevel, parameterName=code_block.out1, value=code_block_3)
