# Dynamo graph Views.Duplicate.dyn (Dynamo 2.16.1.2727)
# author: Julia Lubacheski
# Duplica Vistas
# packages: Clockwork for Dynamo 2.x 2.1.0

views = Views("Level 1")  # graph input
name = Element.Name(element=views)
code_block = CodeBlock(nome=name) { nome+"Cópia"; }
duplicate = Custom[View.Duplicate](view=views, name=code_block)  # package Clockwork for Dynamo 2.x; Duplicates a given view
